# Dynamo custom node NSGA_II Function-SCH.dyf (Dynamo 0.7.2.15398)
# category: Optimo.Optimo
# The function that does the generation for NSGA_II.

init = Input()
code_block = CodeBlock(lst=init) { lst[1]; lst[0]; }
loweLomits = Input()
upperLimits = Input()
generationAlgorithm = Optimo.NSGA_II.GenerationAlgorithm(code_block.out1, loweLomits, upperLimits)
code_block_2 = CodeBlock(pop=generationAlgorithm) { pop[0]; }
code_block_3 = CodeBlock(X=code_block_2) { Math.Pow(X,2); }
code_block_4 = CodeBlock(X=code_block_2) { Math.Pow(X-2,2); }
create = List.Create(code_block_3, code_block_4)
assignFitnessFuncResults = Optimo.NSGA_II.AssignFitnessFuncResults(generationAlgorithm, create)
sorting = Optimo.NSGA_II.Sorting(code_block.out1, assignFitnessFuncResults, loweLomits, upperLimits)
code_block_5 = CodeBlock(a=code_block.out0) { a+1; }
create_2 = List.Create(sorting, code_block_5)
Results = Output(create_2)
