# Dynamo custom node NSGA_II Loop.dyf (Dynamo 0.7.2.20919)
# category: Core.Evaluate
# Takes an initital value, a function to produce a new value, and a function that determines whether to keep looping based on the current value.
# In effect, produces the following while loop:
# while(continue?(init))
#     init = mutator(init);
# return init;

mutator = Input()
completionCheck = Input()
init = Input()
code_block = CodeBlock(mutator, completionCheck, init)
# ---------- code_block.designscript (10 lines) ----------
mutator;
completionCheck;
a = [Imperative]
{
    while (init[1]<completionCheck)
    {
        init = __Apply(mutator, init);
    }
    return = init;
};
# ----------------------------------------
result = Output(code_block.out2)
