# Dynamo graph jmetal-14-SCH.dyn (Dynamo 0.7.2.15398)

file_path = Filename("C:\Users\MRahmaniAsl-x\Desktop\gbXML\test.csv")
code_block = CodeBlock { 50; }
code_block_2 = CodeBlock { -9; }
create = List.Create(code_block_2)
code_block_3 = CodeBlock { 10; }
create_2 = List.Create(code_block_3)
nsga_ii_function_sch = Custom[NSGA_II Function-SCH](loweLomits=create, upperLimits=create_2)  # The function that does the generation for NSGA_II.
code_block_4 = CodeBlock { 10; }
code_block_5 = CodeBlock { 2; }
initialSolutionList = Optimo.NSGA_II.InitialSolutionList(code_block_4, code_block_5, create, create_2)
code_block_6 = CodeBlock(pop=initialSolutionList) { pop[0]; }
code_block_7 = CodeBlock(x=code_block_6) { Math.Pow(x,2); }
code_block_8 = CodeBlock(x=code_block_6) { Math.Pow(x-2,2); }
create_3 = List.Create(code_block_7, code_block_8)
assignFitnessFuncResults = Optimo.NSGA_II.AssignFitnessFuncResults(initialSolutionList, create_3)
code_block_9 = CodeBlock { 1; }
create_4 = List.Create(assignFitnessFuncResults, code_block_9)
nsga_ii_loop = Custom[NSGA_II Loop](completionCheck=code_block, mutator=nsga_ii_function_sch, init=create_4)  # Takes an initital value, a function to produce a new value, and a function that determines whether to keep looping based on the current value. In effect, produces the following while loop: while(continue?(init)) init = mutator(init); return init;
code_block_10 = CodeBlock(a=nsga_ii_loop) { a[0]; }
exportToCSV = File.ExportToCSV(file_path, code_block_10)
